% Simulink data dictionary MCU_FOC_MAIN_DD.sldd

PAS_ONE_SPD_THSD_U16 = Simulink.Parameter(13200, StorageClass="ExportedGlobal", DataType="uint16", Unit="meter/hour")
PAS_TWO_SPD_THSD_U16 = Simulink.Parameter(16200, StorageClass="ExportedGlobal", DataType="uint16", Unit="meter/hour")
PAS_THREE_SPD_THSD_U16 = Simulink.Parameter(19200, StorageClass="ExportedGlobal", DataType="uint16", Unit="meter/hour")
PAS_FOUR_SPD_THSD_U16 = Simulink.Parameter(22200, StorageClass="ExportedGlobal", DataType="uint16", Unit="meter/hour")
PAS_FIVE_SPD_THSD_U16 = Simulink.Parameter(25000, StorageClass="ExportedGlobal", DataType="uint16", Unit="meter/hour")
DEFAULT_PAS_SPD_U16 = Simulink.Parameter(0, StorageClass="ExportedGlobal", DataType="uint16", Unit="meter/hour")
dm_VehSpdDem_u16_ref = Simulink.Signal(StorageClass="ExportedGlobal", DataType="uint16", Unit="meter/hour")
MAX_SPD_VALUE = Simulink.Parameter(25000, StorageClass="ExportedGlobal", DataType="uint16", Unit="meter/hour")
MIN_SPD_VALUE = Simulink.Parameter(0, StorageClass="ExportedGlobal", DataType="uint16", Unit="meter/hour")
mid_flg_LeftBrake_Status = Simulink.Signal(StorageClass="ExportedGlobal", DataType="boolean")
mid_flg_RightBrake_Status = Simulink.Signal(StorageClass="ExportedGlobal", DataType="boolean")
em_DrvModSpdLim_u16 = Simulink.Signal(StorageClass="ExportedGlobal", DataType="uint16", Unit="meter/hour")
mid_WalkModeAct_flg = Simulink.Signal(StorageClass="ExportedGlobal", DataType="boolean")
mid_CCModeAct_flg = Simulink.Signal(StorageClass="ExportedGlobal", DataType="boolean")
tm_VehSpd_u16 = Simulink.Signal(StorageClass="ExportedGlobal", DataType="uint16", Unit="meter/hour")
mi_Throttle_mvu16 = Simulink.Signal(StorageClass="ExportedGlobal", DataType="uint16", Unit="mV")
mid_VehModes_u8 = Simulink.Signal(StorageClass="ExportedGlobal", DataType="uint8")
mid_flg_ChildModeEn = Simulink.Signal(StorageClass="ExportedGlobal", DataType="boolean")
mid_PAS_En_flg = Simulink.Signal(StorageClass="ExportedGlobal", DataType="boolean")
mid_PedalAssist_u8 = Simulink.Signal(StorageClass="ExportedGlobal", DataType="uint8")
WALKMODE_SPD_LIM_U16 = Simulink.Parameter(4500, StorageClass="ExportedGlobal", DataType="uint16", Unit="meter/hour")
THROTTLE_THRESHOLD_U16 = Simulink.Parameter(950, StorageClass="ExportedGlobal", DataType="uint16", Unit="meter/hour")
FITNESS_MODE_U8 = Simulink.Parameter(5, StorageClass="ExportedGlobal", DataType="uint8")
THROTTLE_SPD_LIM_U16 = Simulink.Parameter(25000, StorageClass="ExportedGlobal", DataType="uint16", Unit="meter/hour")
DEFAULT_SPD_LIM_U16 = Simulink.Parameter(0, StorageClass="ExportedGlobal", DataType="uint16", Unit="meter/hour")
MODEL_CONFIG_PARENT = Simulink.ConfigSet(StartTime="0", StopTime="10", FixedStep="0.001", Solver="FixedStepDiscrete", ProdHWDeviceType="Intel->x86-64 (Windows64)", SystemTargetFile="ert.tlc", TargetLang="C")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
MODEL_CONFIG_CHILD = Simulink.ConfigSet(StartTime="0", StopTime="10", FixedStep="0.001", Solver="FixedStepDiscrete", ProdHWDeviceType="Intel->x86-64 (Windows64)", SystemTargetFile="ert.tlc", TargetLang="C")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
BOOLEAN_ONE = Simulink.Parameter(1, StorageClass="ExportedGlobal", DataType="boolean")
THROTTLE_INITIATION_VALUE = Simulink.Parameter(950, StorageClass="ExportedGlobal", DataType="uint16")
SAMPLE_TIME_1MS = Simulink.Parameter(1, StorageClass="ExportedGlobal", DataType="uint16")
THROTTLE_DEACTIVATION_VALUE = Simulink.Parameter([])
MILLI_SEC_COUNTS_5000 = Simulink.Parameter(5000, StorageClass="ExportedGlobal", DataType="uint16", Unit="ms")
THROTT_ERR_UPRTHSD_U16 = Simulink.Parameter(5000, StorageClass="ExportedGlobal", DataType="uint16")
THROTT_ERR_LWRTHSD_U16 = Simulink.Parameter(800, StorageClass="ExportedGlobal", DataType="uint16")